# Grasshopper definition 160407_CityMatrix.gh (Grasshopper 0.9.76)
# plug-ins: Python Interpreter, gHowl, HDTReference

# ---- group: mesh coloring
com_color = ColourSwatch(SwatchColor=RGB(255, 122, 122))
com_gray = ColourSwatch(SwatchColor=RGB(171, 171, 171))
res_color = ColourSwatch(SwatchColor=RGB(251, 255, 122))
mesh = Mesh([<mesh referenced from the Rhino model> x2])
sidewalk = ColourSwatch(SwatchColor=RGB(107, 107, 107))
bikelane = ColourSwatch(SwatchColor=RGB(47, 153, 49))
res_gray = ColourSwatch(SwatchColor=RGB(227, 227, 227))
parking = ColourSwatch(SwatchColor=RGB(196, 156, 100))
blank = ColourSwatch(SwatchColor=RGB(110, 110, 110))
road = ColourSwatch(SwatchColor=RGB(64, 64, 64))
park = ColourSwatch(SwatchColor=RGB(170, 199, 68))
# 3D City Grid System
text = ColourSwatch(SwatchColor=RGB(0, 0, 0))
mcol = MeshColours(Mesh=mesh, Colours=road)
mesh_2 = Mesh(mcol)

# ---- group: shrink
number_slider = Slider(0.95, range=0.75..1)

# ---- group: module meshes lego ref: -1
mesh_3 = Mesh(<mesh referenced from the Rhino model>)

# ---- group: module meshes lego ref: 6 line bike
mesh_4 = Mesh(<mesh referenced from the Rhino model>)  # disabled

# ---- group: module meshes lego ref: 0 to 5
mesh_5 = Mesh([<mesh referenced from the Rhino model> x6])

# ---- group: colortizer orgin
# CityMatrix
# 
# by Yan "Ryan" Zhang <ryanz@mit.edu>
# for MIT Media Lab, Changing Place Group, CityScope Project
# March.17th.2016
# LEGO Grid System
pt = Point(<point referenced from the Rhino model>)

# ---- group: module meshes lego ref: 6 line car
mesh_6 = Mesh(<mesh referenced from the Rhino model>)  # disabled

# ---- group: table size ref pt
pt_2 = Point(<point referenced from the Rhino model>)

# ----
panel = Panel("7002")  # disabled
# PEVs
panel_2 = Panel("127.0.0.1")  # disabled
swatch = ColourSwatch(SwatchColor=RGB(255, 255, 255))  # disabled
# Traffic Heatmap
# Energy per Capita Heatmap
panel_3 = Panel("C:\Users\RYAN\Documents\GitHub\CityMatrix\Map\PEV_PSG AND PKG_300DPI.png")  # disabled
panel_4 = Panel("0.01")  # disabled
xy = XYPlane(Origin=pt)
dist = Distance(PointA=pt, PointB=pt_2)
mesh_7 = Mesh(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)  # disabled

# ---- group: 6 intersect bike
mesh_8 = Mesh(<mesh referenced from the Rhino model>)  # disabled

# ----
timer = Timer(TimerInterval=500, Target=division)  # disabled

# ---- group: 6 intersect car
mesh_9 = Mesh(<mesh referenced from the Rhino model>)  # disabled

# ---- group: 3D building site move amount
X = UnitX(Factor="10000")

# ---- group: udp receiver
udp = UDPReceiver(Address=panel_2, Port=panel, Pattern=0)  # -> Info, Data; disabled

# ----
_4_commed = Slider(12, range=1..25)
_1_resmed = Slider(12, range=1..25)
_3_comhq = Slider(6, range=1..25)
_0_reslux = Slider(5, range=1..25)
_5_rescw = Slider(23, range=1..25)
_2_resmu = Slider(23, range=1..25)

# ---- group: road quator 0s
mesh_10 = Mesh([<mesh referenced from the Rhino model> x4])
pt_3 = Point(<point referenced from the Rhino model>)

# ----
scale_nu = ScaleNU(Geometry=mesh_10, Plane=pt_3, ScaleX=number_slider, ScaleY=number_slider, ScaleZ=1)  # -> Geometry, Transform

# ---- group: base cplane
pln = Plane(xy)

# ----
movetoorgin = MoveToOrgin(G=mesh_3, num=number_slider)
movetoorgin_2 = MoveToOrgin(G=mesh_5, num=number_slider)
split = TextSplit(Text=udp.Data)  # disabled

# ---- group: PEV center pt
pt_4 = Point(split)  # disabled

# ----
vec2pt = Vector2Pt(PointA=Point(0, 0, 0), PointB=pt_4, Unitize=False)  # -> Vector, Length; disabled
move = Move(Geometry=mesh_7, Motion=vec2pt.Vector)  # -> Geometry, Transform; disabled
com = ColourSwatch(SwatchColor=RGB(145, 145, 145))
res = ColourSwatch(SwatchColor=RGB(207, 207, 207))
mjoin = MeshJoin(Meshes=move.Geometry)  # disabled

# ---- group: road quator 1s
mesh_11 = Mesh([<mesh referenced from the Rhino model> x4])
pt_5 = Point(<point referenced from the Rhino model>)

# ----
scale_nu_2 = ScaleNU(Geometry=mesh_11, Plane=pt_5, ScaleX=number_slider, ScaleY=number_slider, ScaleZ=1)  # -> Geometry, Transform
merge = Merge(Data1=_0_reslux, Data2=_1_resmed, Data3=_2_resmu, Data4=_3_comhq, Data5=_4_commed, Data6=_5_rescw)
merge_2 = Merge(Data1=res, Data2=res, Data3=res, Data4=com, Data5=com, Data6=com)

# ---- group: PEVs
previewmat = CustomPreviewMaterials(Geometry=mjoin, DiffuseColor=swatch, Transparency=panel_4, DiffuseBitmap=panel_3)  # disabled

# ---- group: module meshes lego at orgin
mesh_12 = Mesh(movetoorgin_2)

mesh_13 = Mesh(movetoorgin)

# ---- group: color for each type
col = Colour(merge_2)

# ---- group: floor num for each type
int = Integer(merge)

# ---- group: floor height
panel_5 = Panel("3.5")

# ----
multiplication = Multiplication(A=int, B=panel_5)

# ---- group: base height
panel_6 = Panel("5.0")

# ---- group: building height for each type
num = Number(multiplication)

# ---- group: translate example
pt_6 = Point(Point(-15, -8, 0))  # disabled
python = PythonScript(point=pt_6)  # -> out, output; inputs point: Point3d; disabled
# ---------- python: Python ----------
import Rhino

transform = Rhino.Geometry.Transform.Translation(0,0,5)
point.Transform(transform)

output = point
# ---------- end python ----------

# ----
panel_7 = Panel(num)
panel_8 = Panel("216 Pearl St. Cambridge")
panel_9 = Panel("C:\Users\RYAN\Documents\GitHub\CityMatrix\Data\colortizer_data_rhino_02_YZ.txt")
panel_10 = Panel("C:\Users\RYAN\Documents\GitHub\CityMatrix\Data\colortizer_data_sample.txt")
# Parsing Colortizer Data (CityMatrix 16x16)
panel_11 = Panel("C:\Users\RYAN\Documents\GitHub\CityMatrix\Data\colortizer_data.txt")
panel_12 = Panel("C:\Users\RYAN\Documents\GitHub\CityMatrix\Data\colortizer_data_rhino_01_YZ.txt")

# ---- group: udp receiver
udp_2 = UDPReceiver(Address="127.0.0.1", Port="7001", Pattern=0)  # -> Info, Data

# ----
split_2 = TextSplit(Text=udp_2.Data)

# ---- group: reading txt
file = ReadFile(File=panel_9, PerLineParse=True)

# ---- group: colortizer data
txt = Text(file)

# ----
panel_13 = Panel(txt)
split_3 = SplitList(List=txt, Index=9)  # -> ListA, ListB
pshift = ShiftPaths(Data=split_3.ListB, Offset=-1)
pshift_2 = ShiftPaths(Data=split_3.ListA, Offset=-1)
item = ListItem(List=pshift_2, Index=4, Wrap=False)
item_2 = ListItem(List=pshift_2, Index=2, Wrap=False)
item_3 = ListItem(List=pshift_2, Index=3, Wrap=False)
item_4 = ListItem(List=pshift_2, Index=5, Wrap=False)
item_5 = ListItem(List=pshift_2, Index=6, Wrap=False)
item_6 = ListItem(List=pshift_2, Index=7, Wrap=False)
item_7 = ListItem(List=pshift_2, Index=1, Wrap=False)
item_8 = ListItem(List=pshift_2, Index=0, Wrap=False)
item_9 = ListItem(List=pshift_2, Index=8, Wrap=False)
split_4 = TextSplit(Text=item, Separators="\t")
split_5 = TextSplit(Text=item_2, Separators="\t")
split_6 = TextSplit(Text=item_3, Separators="\t")
split_7 = TextSplit(Text=item_4, Separators="\t")
split_8 = TextSplit(Text=item_5, Separators="\t")
split_9 = TextSplit(Text=item_6, Separators="\t")
split_10 = TextSplit(Text=item_7, Separators="\t")
split_11 = TextSplit(Text=item_8, Separators="\t")
split_12 = TextSplit(Text=item_9, Separators="\t")
pshift_3 = ShiftPaths(Data=split_4, Offset=1)
pshift_4 = ShiftPaths(Data=split_5, Offset=1)
pshift_5 = ShiftPaths(Data=split_6, Offset=1)
pshift_6 = ShiftPaths(Data=split_7, Offset=1)
pshift_7 = ShiftPaths(Data=split_8, Offset=1)
pshift_8 = ShiftPaths(Data=split_9, Offset=1)
pshift_9 = ShiftPaths(Data=split_10, Offset=1)
pshift_10 = ShiftPaths(Data=split_11, Offset=1)
pshift_11 = ShiftPaths(Data=split_12, Offset=1)
item_10 = ListItem(List=pshift_3, Index=0, Wrap=False)
item_11 = ListItem(List=pshift_4, Index=0, Wrap=False)
item_12 = ListItem(List=pshift_5, Index=0, Wrap=False)
item_13 = ListItem(List=pshift_6, Index=0, Wrap=False)
item_14 = ListItem(List=pshift_7, Index=0, Wrap=False)
item_15 = ListItem(List=pshift_8, Index=0, Wrap=False)
item_16 = ListItem(List=pshift_9, Index=0, Wrap=False)
item_17 = ListItem(List=pshift_10, Index=0, Wrap=False)
item_18 = ListItem(List=pshift_11, Index=0, Wrap=False)
txt_2 = Text(item_10)
txt_3 = Text(item_11)
txt_4 = Text(item_12)
txt_5 = Text(item_13)
txt_6 = Text(item_14)
txt_7 = Text(item_15)
txt_8 = Text(item_16)
txt_9 = Text(item_17)
txt_10 = Text(item_18)
panel_14 = Panel(txt_2)
panel_15 = Panel(txt_3)
panel_16 = Panel(txt_4)
panel_17 = Panel(txt_5)
panel_18 = Panel(txt_6)
panel_19 = Panel(txt_7)
panel_20 = Panel(txt_8)
panel_21 = Panel(txt_9)
panel_22 = Panel(txt_10)
item_19 = ListItem(List=pshift_3, Index=1, Wrap=False)

# ---- group: dockRotation
int_2 = Integer(item_19)

int_3 = Integer(item_19)

# ----
item_20 = ListItem(List=pshift_4, Index=1, Wrap=False)
item_21 = ListItem(List=pshift_5, Index=1, Wrap=False)

# ---- group: dockID
int_4 = Integer(item_21)

int_5 = Integer(item_21)

# ----
item_22 = ListItem(List=pshift_6, Index=1, Wrap=False)

# ---- group: slider1
num_2 = Number(item_22)

num_3 = Number(item_22)

# ----
item_23 = ListItem(List=pshift_7, Index=1, Wrap=False)

# ---- group: toggle1
bool = Boolean(item_23)

bool_2 = Boolean(item_23)

# ----
item_24 = ListItem(List=pshift_8, Index=1, Wrap=False)

# ---- group: toggle2
bool_3 = Boolean(item_24)

bool_4 = Boolean(item_24)

# ----
item_25 = ListItem(List=pshift_9, Index=1, Wrap=False)

# ---- group: gridExtent_x
int_6 = Integer(item_25)

int_7 = Integer(item_25)

# ----
division = Division(A=dist, B=int_6)

# ---- group: cell size
num_4 = Number(division)

num_5 = Number(division)

# ----
division_2 = Division(A=num_5, B=2)
multiplication_2 = Multiplication(A=division_2, B=Slider(0.95, range=0..1))
neg = Negative(Value=multiplication_2)
dom = ConstructDomain(DomainStart=neg, DomainEnd=multiplication_2)

# ---- group: gridExtent_x
# Dashboard
int_8 = Integer(item_25)

# ----
item_26 = ListItem(List=pshift_10, Index=1, Wrap=False)
item_27 = ListItem(List=pshift_11, Index=1, Wrap=False)

# ---- group: toggle2
bool_5 = Boolean(item_27)

# Human Interaction
# Parking
bool_6 = Boolean(item_27)

# ---- group: dockRotation
int_9 = Integer(item_19)

# ---- group: IDMax
int_10 = Integer(item_20)

# ---- group: dockID
int_11 = Integer(item_21)

# ---- group: slider1
num_6 = Number(item_22)

# ---- group: toggle1
bool_7 = Boolean(item_23)

# ---- group: toggle2
bool_8 = Boolean(item_24)

# ---- group: gridExtent_x
int_12 = Integer(item_25)

# ---- group: gridIndex
int_13 = Integer(item_26)

# ---- group: toggle2
bool_9 = Boolean(item_27)

# ----
panel_23 = Panel(int_9)
panel_24 = Panel(int_10)
panel_25 = Panel(int_11)
panel_26 = Panel(num_6)
panel_27 = Panel(bool_7)
panel_28 = Panel(bool_8)
panel_29 = Panel(int_12)
panel_30 = Panel(int_13)
panel_31 = Panel(bool_9)
item_28 = ListItem(List=pshift_9, Index=2, Wrap=False)

# ---- group: gridExtent_y
int_14 = Integer(item_28)

int_15 = Integer(item_28)

int_16 = Integer(item_28)

int_17 = Integer(item_28)

# ----
panel_32 = Panel(int_17)
multiplication_3 = Multiplication(A=int_12, B=int_17)
split_13 = SplitList(List=pshift, Index=multiplication_3)  # -> ListA, ListB
pshift_12 = ShiftPaths(Data=split_13.ListA, Offset=-1)
split_14 = TextSplit(Text=pshift_12, Separators="\t")
pshift_13 = ShiftPaths(Data=split_14, Offset=1)

# ---- group: all data
int_18 = Integer(pshift_13)

# ----
panel_33 = Panel(int_18)  # disabled
item_29 = ListItem(List=int_18, Index="3", Wrap=False)
item_30 = ListItem(List=int_18, Index="0", Wrap=False)
item_31 = ListItem(List=int_18, Index="1", Wrap=False)
item_32 = ListItem(List=int_18, Index="2", Wrap=False)
pshift_14 = ShiftPaths(Data=item_30, Offset=-1)
pshift_15 = ShiftPaths(Data=item_31, Offset=-1)
pshift_16 = ShiftPaths(Data=item_32, Offset=-1)
pshift_17 = ShiftPaths(Data=item_29, Offset=-1)

# ---- group: x
int_19 = Integer(pshift_15)

int_20 = Integer(int_19)

int_21 = Integer(int_19)

int_22 = Integer(int_19)

# ---- group: module id
int_23 = Integer(pshift_14)

int_24 = Integer(int_23)

int_25 = Integer(int_23)

# ----
larger = LargerThan(FirstNumber=int_24, SecondNumber="0")  # -> LargerThan, OrEqualTo
smaller = SmallerThan(FirstNumber=int_24, SecondNumber="5")  # -> SmallerThan, OrEqualTo
and = GateAnd(A=larger.OrEqualTo, B=smaller.OrEqualTo)

# ---- group: is building or not
bool_10 = Boolean(and)

# ----
dispatch = Dispatch(List=int_24, DispatchPattern=bool_10)  # -> ListA, ListB

# ---- group: building id
int_26 = Integer(dispatch.ListA)

# ----
larger_2 = LargerThan(FirstNumber=int_25, SecondNumber="0")  # -> LargerThan, OrEqualTo
smaller_2 = SmallerThan(FirstNumber=int_25, SecondNumber="5")  # -> SmallerThan, OrEqualTo
item_33 = ListItem(List=col, Index=graft(int_26), Wrap=False)
and_2 = GateAnd(A=larger_2.OrEqualTo, B=smaller_2.OrEqualTo)
pshift_18 = ShiftPaths(Data=item_33, Offset=-1)
dispatch_2 = Dispatch(List=int_25, DispatchPattern=and_2)  # -> ListA, ListB
smaller_3 = SmallerThan(FirstNumber=int_25, SecondNumber="0")  # -> SmallerThan, OrEqualTo
item_34 = ListItem(List=mesh_12, Index=graft(dispatch_2.ListA), Wrap=False)

# ---- group: color for each building
col_2 = Colour(pshift_18)

# ----
item_35 = ListItem(List=panel_7, Index=graft(int_26), Wrap=False)
pshift_19 = ShiftPaths(Data=item_34, Offset=-1)
pshift_20 = ShiftPaths(Data=item_35, Offset=-1)

# ---- group: building height of each building
num_7 = Number(pshift_20)

# ----
addition = Addition(A=num_7, B=panel_6)
dom_2 = ConstructDomain(DomainStart=0, DomainEnd=addition)

# ---- group: module id
int_27 = Integer(int_23)

# ---- group: y
int_28 = Integer(pshift_16)

int_29 = Integer(int_28)

int_30 = Integer(int_28)

# ---- group: road check matrix
python_2 = PythonScript(xe=int_6, ye=int_14, x=int_21, y=int_30, id=int_25)  # -> out, m; inputs x: list, y: list, id: list
# ---------- python_2: Python ----------
"""
CityMatrix

written by "Ryan" Yan Zhang <ryanz@mit.edu>
for MIT Media Lab, Changing Place Group
April.6th.2016
"""

import rhinoscriptsyntax as rs

m = [[-1 for n in range(xe)] for n in range(ye)]

for n in range(len(id)):
    if id[n] == 7:
        m[y[n]][x[n]] = 6
    else:
        m[y[n]][x[n]] = id[n]

for n in range(ye):
    print m[n]
# ---------- end python_2 ----------

# ----
modulecenter = ModuleCenter(pt=pt, num=num_4, int_2=int_21, int=int_30)  # -> pt_5, transform_2

# ---- group: road check list
python_3 = PythonScript(xe=int_6, ye=int_14, x=int_21, y=int_30, id=int_25, m=python_2.m)  # -> out, rdType; inputs x: list, y: list, id: list, m: list
# ---------- python_3: Python ----------
"""
CityMatrix

written by "Ryan" Yan Zhang <ryanz@mit.edu>
for MIT Media Lab, Changing Place Group
April.6th.2016
"""

import rhinoscriptsyntax as rs

rdType = []

for n in range(len(id)):
    
    code = []
    
    if id[n]==6 or id[n]==7:
        
        # 0: check x, y+1
        if y[n]+1>ye-1:
            code.append(1)
        else:
            if m[y[n]+1][x[n]]==6:
                code.append(1)
            else:
                code.append(0)
        
        # 1: check x+1, y
        if x[n]+1>xe-1:
            code.append(1)
        else:
            if m[y[n]][x[n]+1]==6:
                code.append(1)
            else:
                code.append(0)
        
        # 2: check x, y-1
        if y[n]-1<0:
            code.append(1)
        else:
            if m[y[n]-1][x[n]]==6:
                code.append(1)
            else:
                code.append(0)
        
        # 3: check x-1, y
        if x[n]-1<0:
            code.append(1)
        else:
            if m[y[n]][x[n]-1]==6:
                code.append(1)
            else:
                code.append(0)
    
    else:
        
        code = [0,0,0,0]
    
    print code
    rdType.append(code)
# ---------- end python_3 ----------

# ----
xform = Transform(modulecenter.transform_2)  # disabled

# ---- group: module center
pt_7 = Point(modulecenter.pt_5)

pt_8 = Point(pt_7)

# ----
dispatch_3 = Dispatch(List=pt_8, DispatchPattern=bool_10)  # -> ListA, ListB

# ---- group: road check list
python_4 = PythonScript(pt=pt_7, id=int_25, rdType=python_3.rdType, rdQua0=scale_nu.Geometry, c0=pt_3, rdQua1=scale_nu_2.Geometry, c1=pt_5)  # -> out, allRoadMesh; inputs pt: list, id: list, rdType: list, rdQua0: list, rdQua1: list
# ---------- python_4: Python ----------
"""
CityMatrix

written by "Ryan" Yan Zhang <ryanz@mit.edu>
for MIT Media Lab, Changing Place Group
April.6th.2016
"""

import rhinoscriptsyntax as rs
import Rhino.Geometry as rg

allRoadMesh = []

for n in range(len(id)):
    
    if id[n]==6 or id[n]==7:
        
        for i in range(len(rdType[n])):
            t = rdType[n][i]
            v = rs.PointCoordinates(pt[n])
            if t == 0:
                c = rs.PointCoordinates(c0)
                vx = v[0]-c[0]
                vy = v[1]-c[1]
                new = rs.CopyObject(rdQua0[i],(vx,vy,0.))
            else:
                c = rs.PointCoordinates(c1)
                vx = v[0]-c[0]
                vy = v[1]-c[1]
                new = rs.CopyObject(rdQua1[i],(vx,vy,0.))
            allRoadMesh.append(new)
# ---------- end python_4 ----------

# ---- group: road mesh final!
mesh_14 = Mesh(python_4.allRoadMesh)

# ---- group: building center
pt_9 = Point(dispatch_3.ListA)

# ----
move_2 = Move(Geometry=mesh_14, Motion=X)  # -> Geometry, Transform
box = DomainBox(Base=pt_9, X=dom, Y=dom, Z=dom_2)
dispatch_4 = Dispatch(List=pt_7, DispatchPattern=smaller_3.SmallerThan)  # -> ListA, ListB
vec2pt_2 = Vector2Pt(PointA=Point(0, 0, 0), PointB=dispatch_4.ListA, Unitize=False)  # -> Vector, Length
move_3 = Move(Geometry=box, Motion=X)  # -> Geometry, Transform
dispatch_5 = Dispatch(List=pt_7, DispatchPattern=and_2)  # -> ListA, ListB
move_4 = Move(Geometry=mesh_13, Motion=vec2pt_2.Vector)  # -> Geometry, Transform

# ---- group: building geo
box_2 = Box(move_3.Geometry)

# ---- group: textured buildings
panel_34 = Panel("C:\Users\RYAN\Documents\GitHub\CityMatrix\Map\PEV_PSG AND PKG_300DPI.png")  # disabled
panel_35 = Panel("0.01")  # disabled
swatch_2 = ColourSwatch(SwatchColor=RGB(255, 255, 255))  # disabled
boxmap = BoxMapping(Mesh=box_2, Box=box_2)  # disabled
previewmat_2 = CustomPreviewMaterials(Geometry=boxmap, DiffuseColor=swatch_2, Transparency=panel_35, DiffuseBitmap=panel_34)  # disabled

# ----
vec2pt_3 = Vector2Pt(PointA=Point(0, 0, 0), PointB=dispatch_5.ListA, Unitize=False)  # -> Vector, Length

# ---- group: road mesh final!
mesh_15 = Mesh(python_4.allRoadMesh)

# ---- group: blank
mesh_16 = Mesh(move_4.Geometry)

mesh_17 = Mesh(mesh_16)

# ----
move_5 = Move(Geometry=mesh_17, Motion=X)  # -> Geometry, Transform

# ---- group: 3D Buldings
preview = CustomPreview(Geometry=box_2, Shader=col_2)

# ---- group: road
mesh_18 = Mesh(move_2.Geometry)

# ---- group: blank
mesh_19 = Mesh(move_5.Geometry)

# ---- group: y
int_31 = Integer(int_28)

# ---- group: rotation
int_32 = Integer(pshift_17)

int_33 = Integer(int_32)

int_34 = Integer(int_32)

# ----
dispatch_6 = Dispatch(List=int_34, DispatchPattern=and_2)  # -> ListA, ListB
rotate = Rotate(Geometry=pshift_19, Angle=degrees(dispatch_6.ListA), Plane=PlaneXY(0, 0, 0))  # -> Geometry, Transform
move_6 = Move(Geometry=rotate.Geometry, Motion=vec2pt_3.Vector)  # -> Geometry, Transform

# ---- group: building lego modules
mesh_20 = Mesh(move_6.Geometry)

# ---- group: rotation
int_35 = Integer(int_32)

# ----
panel_36 = Panel(int_19)  # disabled
panel_37 = Panel(int_28)  # disabled
panel_38 = Panel(int_32)  # disabled
panel_39 = Panel(int_23)  # disabled

# ---- group: total cell #
int_36 = Integer(multiplication_3)

# ----
panel_40 = Panel(int_36)

# ---- group: sticky rotations
python_5 = PythonScript(x=int_32)  # -> out, rotations; inputs x: list; disabled
# ---------- python_5: Python ----------
"""
Realtime Simulator

written by Yan "Ryan" Zhang <ryanz@mit.edu>
for MIT Media Lab, Changing Place Group, CityScope Project
March.7th.2016
"""

import scriptcontext as sc

sc.sticky["rotations"] = x

rotations = sc.sticky["rotations"]
# ---------- end python_5 ----------

# ---- group: sticky y steps
python_6 = PythonScript(x=int_28)  # -> out, ySteps; inputs x: list; disabled
# ---------- python_6: Python ----------
"""
Realtime Simulator

written by Yan "Ryan" Zhang <ryanz@mit.edu>
for MIT Media Lab, Changing Place Group, CityScope Project
March.7th.2016
"""

import scriptcontext as sc

sc.sticky["ySteps"] = x

ySteps = sc.sticky["ySteps"]
# ---------- end python_6 ----------

# ---- group: sticky moduleIDs
python_7 = PythonScript(x=int_23)  # -> out, moduleIDs; inputs x: list; disabled
# ---------- python_7: Python ----------
"""
Realtime Simulator

written by Yan "Ryan" Zhang <ryanz@mit.edu>
for MIT Media Lab, Changing Place Group, CityScope Project
March.7th.2016
"""

import scriptcontext as sc

sc.sticky["moduleIDs"] = x

moduleIDs = sc.sticky["moduleIDs"]
# ---------- end python_7 ----------

# ---- group: sticky x steps
python_8 = PythonScript(x=int_19)  # -> out, xSteps; inputs x: list; disabled
# ---------- python_8: Python ----------
"""
Realtime Simulator

written by Yan "Ryan" Zhang <ryanz@mit.edu>
for MIT Media Lab, Changing Place Group, CityScope Project
March.7th.2016
"""

import scriptcontext as sc

sc.sticky["xSteps"] = x

xSteps = sc.sticky["xSteps"]
# ---------- end python_8 ----------

# ----
panel_41 = Panel(python_5.rotations)  # disabled
panel_42 = Panel(python_5.out)  # disabled
panel_43 = Panel(python_6.ySteps)  # disabled
panel_44 = Panel(python_6.out)  # disabled
panel_45 = Panel(python_8.xSteps)  # disabled
panel_46 = Panel(python_8.out)  # disabled
panel_47 = Panel(python_7.moduleIDs)  # disabled
panel_48 = Panel(python_7.out)  # disabled

# ==== cluster ModuleCenter
pt = ClusterInput()
int = ClusterInput()
num = ClusterInput()
int_2 = ClusterInput()

# ---- group: y
int_3 = Integer(int)

# ---- group: cell size
num_2 = Number(num)

# ---- group: x
int_4 = Integer(int_2)

# ---- group: center
pt_2 = Point(pt)

# ----
pt_3 = ConstructPoint(XCoordinate=0, YCoordinate=0, ZCoordinate=0)  # disabled
addition = Addition(A=int_4, B=0.5)
vec2pt = Vector2Pt(PointA=pt_3, PointB=pt_2, Unitize=False)  # -> Vector, Length; disabled
addition_2 = Addition(A=int_3, B=0.5)
multiplication = Multiplication(A=addition, B=num_2)
lng = ListLength(List=int_4)  # disabled
move = Move(Motion=vec2pt.Vector)  # -> Geometry, Transform; disabled
multiplication_2 = Multiplication(A=addition_2, B=num_2)
X = UnitX(Factor=multiplication)
repeat = RepeatData(Data=move.Transform, Length=lng)  # disabled
neg = Negative(Value=multiplication_2)
move_2 = Move(Geometry=pt_2, Motion=X)  # -> Geometry, Transform
graft = GraftTree(Tree=move_2.Transform, IncludeEmptyLists=True, IncludeNullItems=True)  # disabled
Y = UnitY(Factor=neg)
pshift = ShiftPaths(Data=repeat, Offset=-1)  # disabled
move_3 = Move(Geometry=move_2.Geometry, Motion=Y)  # -> Geometry, Transform
graft_2 = GraftTree(Tree=move_3.Transform, IncludeEmptyLists=True, IncludeNullItems=True)  # disabled
comp = Compound(Transforms=[graft, graft_2])  # disabled
graft_3 = GraftTree(Tree=pshift, IncludeEmptyLists=True, IncludeNullItems=True)  # disabled
comp_2 = Compound(Transforms=[comp, graft_3])  # disabled

# ---- group: module center
pt_4 = Point(move_3.Geometry)

# ----
pshift_2 = ShiftPaths(Data=comp_2, Offset=-1)  # disabled
transform = Transform(pshift_2)  # disabled
pt_5 = ClusterOutput(pt_4)
transform_2 = ClusterOutput(transform)  # disabled

# ==== cluster MoveToOrgin
num = ClusterInput()
G = ClusterInput()
num_2 = Number(num)
geobottomcenter = GeoBottomCenter(geo=G)
vec2pt = Vector2Pt(PointA=geobottomcenter, PointB=Point(0, 0, 0), Unitize=False)  # -> Vector, Length
move = Move(Geometry=G, Motion=vec2pt.Vector)  # -> Geometry, Transform
scale_nu = ScaleNU(Geometry=move.Geometry, Plane=PlaneXY(0, 0, 0), ScaleX=num_2, ScaleY=num_2, ScaleZ=1)  # -> Geometry, Transform
G_2 = ClusterOutput(scale_nu.Geometry)

# ==== cluster GeoBottomCenter
geo = ClusterInput()
geo_2 = Geometry(geo)
bbox = BoundingBox(Content=geo_2, Plane=PlaneXY(0, 0, 0))  # -> Box, Box_2
box_corners = BoxCorners(Box=bbox.Box)  # -> CornerA, CornerB, CornerC, CornerD, CornerE, CornerF, CornerG, CornerH
pdecon = Deconstruct(Point=box_corners.CornerA)  # -> XComponent, YComponent, ZComponent
pdecon_2 = Deconstruct(Point=box_corners.CornerC)  # -> XComponent, YComponent, ZComponent
addition = Addition(A=pdecon.XComponent, B=pdecon_2.XComponent)
addition_2 = Addition(A=pdecon.YComponent, B=pdecon_2.YComponent)
division = Division(A=addition, B=2)
division_2 = Division(A=addition_2, B=2)
pt = ConstructPoint(XCoordinate=division, YCoordinate=division_2, ZCoordinate=pdecon.ZComponent)
pt_2 = Point(pt)
pt_3 = ClusterOutput(pt_2)
